# Grasshopper definition Splash.gh (Grasshopper 1.0.8)
# plug-ins: ShapeDiverForGrasshopper

sddp = ShapeDiverDocumentPayload({AbsoluteTolerance=0, AngleTolerance=0, DistanceDisplayPrecision=0, GltfVersion="Gltf2", GrasshopperVersion="1.0.0008", InputGroups="{}", OutputGroups="{}", RelativeTolerance=0, RhinoVersion="8.15.25007.13001", UnitSystem=0, VersionCreated="1.22.0.0", VersionSaved="1.22.0.0"})
point = GetNumber(Slider(48.87, range=0..50), AtLeast=1, AtMost=1, Maximum=1.797693135e+308, Minimum=-1.797693135e+308, TreeAccess=False)
box = Box({Plane=Plane(origin=(0, 50, 0), x=(1, 0, 0), y=(0, -1, 0)), X=Domain(0, 50), Y=Domain(0, 50), Z=Domain(-50, 0)})
construct_point = ConstructPoint(XCoordinate=point, YCoordinate=point, ZCoordinate=point)
populate_3d = Populate3D(Region=box, Count=100, Seed=1)
density = GetNumber(Slider(0.01, range=0..1), AtLeast=1, AtMost=1, Maximum=1.797693135e+308, Minimum=-1.797693135e+308, TreeAccess=False)
scale = GetNumber(Slider(1, range=0..1), AtLeast=1, AtMost=1, Maximum=1.797693135e+308, Minimum=-1.797693135e+308, TreeAccess=False)
distance = Distance(PointA=populate_3d, PointB=construct_point)
voronoi_3d = Voronoi3D(Points=populate_3d, Box=box)  # -> Cells, Boundary
construct_domain = ConstructDomain(DomainStart=density, DomainEnd=scale)
bounds = Bounds(Numbers=distance)
remap_numbers = RemapNumbers(Value=distance, Source=bounds, Target=construct_domain)  # -> Mapped, Clipped
scale_2 = Scale(Geometry=voronoi_3d.Cells, Center=populate_3d, Factor=remap_numbers.Mapped)  # -> Geometry, Transform
context_bake = ContextBake(Geometry=scale_2.Geometry)
