# Grasshopper definition Splash_hops.gh (Grasshopper 1.0.8)
# plug-ins: Hops

hops = Hops(
    Move=Slider(41, range=0..100),
    Density=Slider(0.23, range=0..1),
    Scale=Slider(0.69, range=0..1),
    CacheResultsInMemory=True,
    CacheSolveResults=True,
    RemoteDefinitionLocation="G:\My Drive\BIM25\CloudDatamang\bimsc25-datamgmt-session01\Splash.gh",
    RemoteSolveVersion=(0, 1, 0),
    ShowInput_Enabled=False,
    ShowInput_Path=False,
    SynchronousSolve=True)
